# Grasshopper definition Firefly_13_Video_Synthesis_ThugHes (1).gh (Grasshopper 0.9.76)
# plug-ins: Firefly.X

# ----
# Webcam Video Stream: The Web Cam Video Stream component will automatically connect to your default video capture device (if available) and begin returning a custom Firefly Bitmap which can be passed through various filters.  This component also supports multiple cameras.  Simply, right-click on the image above to change the camera settings for the video capture.
video_stream = WebCamVideoStream()

# ---- group: Resize Image
rx = Slider(80, range=0..320)
ry = Slider(60, range=0..320)
resize = BitmapResize(BitmapToModify=video_stream, NewResolutionInXAxis=rx, NewResolutionInYAxis=ry)

# ---- group: Video Analysis
# Right-click
# to Enable
# Notes: We can also find out the average direction of movement and cetroids of color within the pixels defined by a bounding box within a Firefly bitmap.  This component will search within this rectangle and determine the average direction of movement (vector) as well as the average colors.  Mutiple bounding boxes can be defined as search areas within an image to determine the general direction of movement and average colors within that area.  Note: Point [0.0, 0.0, 0.0] denotes the lower left hand corner of the image while Point [1.0, 1.0, 0.0] indicates the upper right hand corner of the image.
md_slider = MDSlider(slider_value=Point(0, 0, 0.5), SliderMode=0, x_domain=Domain(0, 1), y_domain=Domain(0, 1), z_domain=Domain(0, 1))
md_slider_2 = MDSlider(slider_value=Point(1, 1, 0.5), SliderMode=0, x_domain=Domain(0, 1), y_domain=Domain(0, 1), z_domain=Domain(0, 1))
rec_2pt = Rectangle2Pt(Plane=PlaneXY(0, 0, 0), PointA=md_slider, PointB=md_slider_2, Radius=0)  # -> Rectangle, Length
rec = Rectangle(rec_2pt.Rectangle)
average = FindVideoAverages(BitmapToModify=resize, MinimumPointOfBoundingArea=md_slider, MaximumPointOfBoundingArea=md_slider_2)  # -> AverageColor, AverageMovementVector, CentroidOfMovement, CentroidOfRedPixels, CentroidOfGreenPixels, CentroidOfBluePixels

# ---- group: Mesh From Image
# Right-click
# to Enable
# Notes: We can also create a mesh from image data.  Here, the height of the mesh is controlled by the luminance of each pixel.  The scale of influence can be controlled using the height slider (works in both positive and negative directions).
height = Slider(1.453, range=-2..36)
mesh = MeshFromImage(Bmp=resize, Sx="1", Sy="1", Z=height, C=True)

# ----
X = UnitX(Factor=1)
Z = UnitZ(Factor=Slider(-6, range=-100..100))

# ---- group: Video Analysis / Green Centroid
preview = CustomPreview(Geometry=average.CentroidOfGreenPixels, Shader=ColourSwatch(SwatchColor=RGB(32, 238, 0)))

# ---- group: Video Analysis / Blue Centroid
preview_2 = CustomPreview(Geometry=average.CentroidOfBluePixels, Shader=ColourSwatch(SwatchColor=RGB(13, 36, 255)))

# ---- group: Video Analysis / Red Centroid
preview_3 = CustomPreview(Geometry=average.CentroidOfRedPixels, Shader=ColourSwatch(SwatchColor=RGB(255, 0, 0)))

# ----
move = Move(Geometry=mesh, Motion=Z)  # -> Geometry, Transform

# ---- group: Video Analysis / Movement Vector
vdis = VectorDisplay(Anchors=average.CentroidOfMovement, Vectors=average.AverageMovementVector)

# ---- group: Video Analysis / Average Color
preview_4 = CustomPreview(Geometry=average.CentroidOfMovement, Shader=average.AverageColor)

# ----
line = LineSDL(Start=md_slider, Direction=X, Length=1)
series = Series(Start=0, Step=0.1, Count=10)
divide = DivideCurve(Curve=line, Count=10, Kinks=False)  # -> Points, Tangents, Parameters
Y = UnitY(Factor=series)
pt = Point(average.CentroidOfMovement)
move_2 = Move(Geometry=graft(divide.Points), Motion=Y)  # -> Geometry, Transform
sph = Sphere(Base=pt, Radius=".1")
dist = Distance(PointA=pt, PointB=move_2.Geometry)
bnd = Bounds(Numbers=flatten(dist))
dom = ConstructDomain(DomainStart=0, DomainEnd=".055")
remap = RemapNumbers(Value=dist, Source=bnd, Target=dom)  # -> Mapped, Clipped
msphere = MeshSphere(Base=move_2.Geometry, Radius=remap.Mapped, UCount=10, VCount=20)
preview_5 = CustomPreview(Geometry=msphere, Shader=ColourSwatch(SwatchColor=RGB(0, 129, 237)))
cir = Circle(Plane=move_2.Geometry, Radius=remap.Mapped)  # disabled
